# Grasshopper definition simple_interpolation.gh (Grasshopper 1.0.7)

number_slider = Slider(0.15, range=0..1)
line = Line(Line((-264.738806, -51.99004975, 0), (207.2761194, 72.51243781, 0)))
end = EndPoints(Curve=line)  # -> Start, End
pdecon = Deconstruct(Point=end.Start)  # -> XComponent, YComponent, ZComponent
pdecon_2 = Deconstruct(Point=end.End)  # -> XComponent, YComponent, ZComponent
eval = Evaluate(F="x + (y-x)*z", x=pdecon.XComponent, y=pdecon_2.XComponent, z=number_slider)
eval_2 = Evaluate(F="x + (y-x)*z", x=pdecon.YComponent, y=pdecon_2.YComponent, z=number_slider)
eval_3 = Evaluate(F="x + (y-x)*z", x=pdecon.ZComponent, y=pdecon_2.ZComponent, z=number_slider)
panel = Panel(eval)
panel_2 = Panel(eval_2)
panel_3 = Panel(eval_3)
pt = ConstructPoint(XCoordinate=panel, YCoordinate=panel_2, ZCoordinate=panel_3)
